# Grasshopper definition AreaGroupViewer.gh (Grasshopper 1.0.7)

visualize = GhPythonScript()  # -> out, outputs
# ---------- visualize: Python ----------
import pickle
import os
print(os.getcwd())

file_name_list_m1 = ['mass1_3_0_0results.pickle', 'mass1_3_10_0results.pickle', 'mass1_3_11_0results.pickle', 'mass1_3_12_0results.pickle', 'mass1_3_13_104results.pickle', 'mass1_3_14_180results.pickle', 'mass1_3_15_0results.pickle', 'mass1_3_4_6results.pickle', 'mass1_3_5_0results.pickle', 'mass1_3_6_0results.pickle', 'mass1_3_7_0results.pickle', 'mass1_3_8_0results.pickle', 'mass1_3_9_0results.pickle', 'mass1_4_10_0results.pickle', 'mass1_4_11_0results.pickle', 'mass1_4_12_0results.pickle', 'mass1_4_13_0results.pickle', 'mass1_4_14_0results.pickle', 'mass1_4_15_0results.pickle', 'mass1_4_4_0results.pickle', 'mass1_4_5_0results.pickle', 'mass1_4_6_0results.pickle', 'mass1_4_7_0results.pickle', 'mass1_4_8_0results.pickle', 'mass1_4_9_0results.pickle', 'mass1_5_10_0results.pickle', 'mass1_5_11_0results.pickle', 'mass1_5_12_0results.pickle', 'mass1_5_13_0results.pickle', 'mass1_5_14_0results.pickle', 'mass1_5_15_0results.pickle', 'mass1_5_4_0results.pickle', 'mass1_5_5_0results.pickle', 'mass1_5_6_0results.pickle', 'mass1_5_7_0results.pickle', 'mass1_5_8_0results.pickle', 'mass1_5_9_0results.pickle']
file_name_list_m2 =['mass1_3_0_61results.pickle', 'mass1_3_10_44results.pickle', 'mass1_3_11_1474results.pickle', 'mass1_3_12_603results.pickle', 'mass1_3_13_669results.pickle', 'mass1_3_14_529results.pickle', 'mass1_3_15_206results.pickle', 'mass1_3_1_12results.pickle', 'mass1_3_3_55results.pickle', 'mass1_3_4_183results.pickle', 'mass1_3_5_484results.pickle', 'mass1_3_6_14results.pickle', 'mass1_3_7_202results.pickle', 'mass1_3_8_63results.pickle', 'mass1_3_9_108results.pickle', 'mass1_4_0_44results.pickle', 'mass1_4_10_44results.pickle', 'mass1_4_11_718results.pickle', 'mass1_4_12_140results.pickle', 'mass1_4_13_741results.pickle', 'mass1_4_14_615results.pickle', 'mass1_4_15_73results.pickle', 'mass1_4_1_2results.pickle', 'mass1_4_3_40results.pickle', 'mass1_4_4_54results.pickle', 'mass1_4_5_254results.pickle', 'mass1_4_6_8results.pickle', 'mass1_4_7_95results.pickle', 'mass1_4_8_36results.pickle', 'mass1_4_9_59results.pickle', 'mass1_5_0_12results.pickle', 'mass1_5_10_100results.pickle', 'mass1_5_11_551results.pickle', 'mass1_5_12_78results.pickle', 'mass1_5_13_622results.pickle', 'mass1_5_14_407results.pickle', 'mass1_5_15_44results.pickle', 'mass1_5_4_18results.pickle', 'mass1_5_5_139results.pickle', 'mass1_5_6_2results.pickle', 'mass1_5_7_50results.pickle', 'mass1_5_8_16results.pickle', 'mass1_5_9_36results.pickle']
datas = [] 
outputs = [] 
for file_name in file_name_list_m1:
    
    path = os.path.join('first_res_m1', file_name)
    with open(path, 'rb') as f:
        data = pickle.load(f)
        outputs.extend(data.outputs)
print(len(outputs))
# ---------- end visualize ----------
visualize_2 = GhPythonScript()  # -> out, outputs
# ---------- visualize_2: Python ----------
import pickle
import os
print(os.getcwd())

file_name_list_m1 = ['mass1_3_0_0results.pickle', 'mass1_3_10_0results.pickle', 'mass1_3_11_0results.pickle', 'mass1_3_12_0results.pickle', 'mass1_3_13_104results.pickle', 'mass1_3_14_180results.pickle', 'mass1_3_15_0results.pickle', 'mass1_3_4_6results.pickle', 'mass1_3_5_0results.pickle', 'mass1_3_6_0results.pickle', 'mass1_3_7_0results.pickle', 'mass1_3_8_0results.pickle', 'mass1_3_9_0results.pickle', 'mass1_4_10_0results.pickle', 'mass1_4_11_0results.pickle', 'mass1_4_12_0results.pickle', 'mass1_4_13_0results.pickle', 'mass1_4_14_0results.pickle', 'mass1_4_15_0results.pickle', 'mass1_4_4_0results.pickle', 'mass1_4_5_0results.pickle', 'mass1_4_6_0results.pickle', 'mass1_4_7_0results.pickle', 'mass1_4_8_0results.pickle', 'mass1_4_9_0results.pickle', 'mass1_5_10_0results.pickle', 'mass1_5_11_0results.pickle', 'mass1_5_12_0results.pickle', 'mass1_5_13_0results.pickle', 'mass1_5_14_0results.pickle', 'mass1_5_15_0results.pickle', 'mass1_5_4_0results.pickle', 'mass1_5_5_0results.pickle', 'mass1_5_6_0results.pickle', 'mass1_5_7_0results.pickle', 'mass1_5_8_0results.pickle', 'mass1_5_9_0results.pickle']
file_name_list_m2 =['mass1_3_0_61results.pickle', 'mass1_3_10_44results.pickle', 'mass1_3_11_1474results.pickle', 'mass1_3_12_603results.pickle', 'mass1_3_13_669results.pickle', 'mass1_3_14_529results.pickle', 'mass1_3_15_206results.pickle', 'mass1_3_1_12results.pickle', 'mass1_3_3_55results.pickle', 'mass1_3_4_183results.pickle', 'mass1_3_5_484results.pickle', 'mass1_3_6_14results.pickle', 'mass1_3_7_202results.pickle', 'mass1_3_8_63results.pickle', 'mass1_3_9_108results.pickle', 'mass1_4_0_44results.pickle', 'mass1_4_10_44results.pickle', 'mass1_4_11_718results.pickle', 'mass1_4_12_140results.pickle', 'mass1_4_13_741results.pickle', 'mass1_4_14_615results.pickle', 'mass1_4_15_73results.pickle', 'mass1_4_1_2results.pickle', 'mass1_4_3_40results.pickle', 'mass1_4_4_54results.pickle', 'mass1_4_5_254results.pickle', 'mass1_4_6_8results.pickle', 'mass1_4_7_95results.pickle', 'mass1_4_8_36results.pickle', 'mass1_4_9_59results.pickle', 'mass1_5_0_12results.pickle', 'mass1_5_10_100results.pickle', 'mass1_5_11_551results.pickle', 'mass1_5_12_78results.pickle', 'mass1_5_13_622results.pickle', 'mass1_5_14_407results.pickle', 'mass1_5_15_44results.pickle', 'mass1_5_4_18results.pickle', 'mass1_5_5_139results.pickle', 'mass1_5_6_2results.pickle', 'mass1_5_7_50results.pickle', 'mass1_5_8_16results.pickle', 'mass1_5_9_36results.pickle']
datas = [] 
outputs = [] 
for file_name in file_name_list_m2:
    
    path = os.path.join('first_res_m2', file_name)
    with open(path, 'rb') as f:
        data = pickle.load(f)
        outputs.extend(data.outputs)
print(len(outputs))
# ---------- end visualize_2 ----------
panel = Panel(visualize.out)
python = GhPythonScript(outputs=visualize.outputs, index=Slider(184, range=0..289))  # -> out, areas, geoms, centers; inputs outputs: list, index: Int32
# ---------- python: Python ----------
import Rhino.Geometry as geo

area_groups = (outputs[index].area_groups)

geoms = ([area_group.geom for area_group in area_groups])
def get_center(region):
    # type: (geo.Curve) -> geo.Point3d
    """region의 중심점 찾기

    Args:
        region : 중심점을 찾을 영역

    Returns:
        중심점
    """

    return geo.AreaMassProperties.Compute(region).Centroid

area_groups = (outputs[index].area_groups)

geoms = ([area_group.geom for area_group in area_groups])


centers = [get_center(geom) for geom in geoms]
areas = []

for area_group in area_groups:
    area_string = ""
    print(area_group.is_area_set)
    for k,v in area_group.area_data:
        area_string += str(k) + "_" + str(v) + "_"
    areas.append(area_string)
print(areas)
# ---------- end python ----------
panel_2 = Panel(visualize_2.out)
python_2 = GhPythonScript(outputs=visualize_2.outputs, index=Slider(3760, range=0..9704))  # -> out, areas, geoms, centers; inputs outputs: list, index: Int32
# ---------- python_2: Python ----------
import Rhino.Geometry as geo

area_groups = (outputs[index].area_groups)

geoms = ([area_group.geom for area_group in area_groups])
def get_center(region):
    # type: (geo.Curve) -> geo.Point3d
    """region의 중심점 찾기

    Args:
        region : 중심점을 찾을 영역

    Returns:
        중심점
    """

    return geo.AreaMassProperties.Compute(region).Centroid

centers = [get_center(geom) for geom in geoms]
areas = []

for area_group in area_groups:
    area_string = ""
    print(area_group.is_area_set)
    for k,v in area_group.area_data:
        area_string += str(k) + "_" + str(v) + "_"
    areas.append(area_string)
print(areas)
# ---------- end python_2 ----------
tag = TextTag(Location=python.centers, Text=python.areas)
tag_2 = TextTag(Location=python_2.centers, Text=python_2.areas)
