# Grasshopper definition GenerateMass.gh (Grasshopper 1.0.7)
# plug-ins: RhinoCodePluginGH

# ---- group: 모듈 변경시 자동 업데이트
module_watcher = GhPythonScript(clear_cache=Button())  # -> out; inputs clear_cache: Boolean
# ---------- module_watcher: Python ----------
import os
import System
import clr
clr.AddReference('System.Core')
from System import Action, Func
import scriptcontext as sc
import time
import importlib
import sys

import Rhino
import scriptcontext as sc
from Grasshopper.Kernel import GH_FileWatcher
from Grasshopper.Kernel import GH_FileWatcherEvents


APP_NAME = 'fx'
ROOT_DIR = os.path.dirname(ghdoc.Path)
PATH_CONNECTOR = '/' if os.name == 'posix' else '\\'
APP_DIR = ROOT_DIR + PATH_CONNECTOR + APP_NAME

print('ROOT', ROOT_DIR)

def get_module_name(subdir, file_name):
    base_name = subdir.replace(ROOT_DIR + PATH_CONNECTOR, '').replace(PATH_CONNECTOR, '.')
    return base_name + '.' + file_name.replace('.py', '')

def reload_all():
    # import sys for windows
    import sys
    
    to_delete = list()
    for module in sys.modules:
        if module.startswith(APP_NAME):
            to_delete.append(module)
    for module in to_delete:
        del sys.modules[module]
        
    for subdir, dirs, files in os.walk(APP_DIR):
        for f in files:
            if not f.endswith('.py') or f == '__init__.py':
                continue
            module_name = get_module_name(subdir, f)
            print(module_name)
            # 중복 리로드 막기
            if module_name in sys.modules:
                continue
            try:
                reload(importlib.import_module(module_name))
            except:
                pass


def callback_func(sender, filename, change):
    reload_all()


def create_python_watcher(dir_name):
    print('create_python_watcher', dir_name)
    return GH_FileWatcher.CreateDirectoryWatcher.Overloads[System.String, System.String, GH_FileWatcherEvents, GH_FileWatcher.FileChanged](
        dir_name, '*.py', GH_FileWatcherEvents.All, callback_func)

class ModuleWatcher:

    def __init__(self):
        self.watcher_list = []
        self.collect_watcher_list()

    def collect_watcher_list(self):
        self.watcher_list.append(create_python_watcher(APP_DIR))
        for subdir, dirs, files in os.walk(APP_DIR):
            for d in dirs:
                dir_name = subdir + PATH_CONNECTOR + d
                self.watcher_list.append(create_python_watcher(dir_name))

    def dispose(self):
        for w in self.watcher_list:
            w.Dispose()

if clear_cache and 'module_watcher' in sc.sticky:
    print('dispose watcher')
    sc.sticky['module_watcher'].dispose()
    del sc.sticky['module_watcher']

if 'module_watcher' not in sc.sticky:
    sc.sticky['module_watcher'] = ModuleWatcher()
    print('module watcher is enabled')
# ---------- end module_watcher ----------
panel = Panel(module_watcher)

# ---- group: input
조절할_인덱스 = Slider(17, range=0..84)

# ----
crv = Curve(<curve referenced from the Rhino model>)
crv_2 = Curve(<curve referenced from the Rhino model>)
crv_3 = Curve(<curve referenced from the Rhino model>)
crv_4 = Curve(<curve referenced from the Rhino model>)
crv_5 = Curve(<curve referenced from the Rhino model>)
crv_6 = Curve(<curve referenced from the Rhino model>)
S = Script(boundary=crv_3, park=crv, forest_entrance=crv_2, close_street=crv_4, slope=crv_5)  # -> out, site, points
# ---------- S: Python ----------
import sys
sys.path.append("C:\\Users\\User\\Documents\\computational_design\\narrative_architects")
from reload import reload_package
import funcs
reload_package(funcs)

from funcs import _utils
import Rhino.Geometry as geo

from funcs import _mass_finder

import Rhino.Geometry as geo
param_geoms = {
"close_street": close_street,
"close_park" : park,
"on_slope":slope,
"on_forest_entrance" : forest_entrance
}
site = _mass_finder.Site(boundary, 2, param_geoms)

points = site.points
# ---------- end S ----------
S_2 = Script(points=S.points, lot=crv_6)  # -> out, point_output; inputs points: list of Point3d, lot: Curve
# ---------- S_2: Python ----------
import sys
sys.path.append("C:\\Users\\User\\Documents\\computational_design\\narrative_architects")
from reload import reload_package
import funcs
reload_package(funcs)
import funcs
from funcs import _utils
import Rhino.Geometry as geo
point_output = [pt  for pt in points if _utils.is_pt_inside(pt, lot)]
# ---------- end S_2 ----------
pt = Point(S_2.point_output)
python = GhPythonScript(x=S_2.point_output, index=조절할_인덱스)  # -> out, point, radius, p_i; inputs x: list of Point3d, index: Int32
# ---------- python: Python ----------
res = [] 
for point_index, point in enumerate(x):
    for i in range(3,5):
        res.append((point, point_index, i))
print(len(res))

a = res[index]
point, p_i, radius = a
# ---------- end python ----------
number_slider = Slider(2, range=0..10)
pt_2 = Point(Point(1335746.321, 1210979.163, 0))
get_mass = Script(site=S.site, mass_index=number_slider, point_a=python.point, point_b=pt_2, radius=python.radius, point_index=python.p_i)  # -> out, a; inputs mass_index: Int32; disabled
# ---------- get_mass: Python ----------
import sys
sys.path.append("C:\\Users\\User\\Documents\\computational_design\\narrative_architects")
from reload import reload_package
import funcs
reload_package(funcs)

from funcs import _utils
import Rhino.Geometry as geo

from funcs._mass_finder import *
from funcs.base import MassResults, MassResult
import math
import pickle

radial_mass_finder = RadialMassFinder(site)
print(point_a, point_b)
radial_mass_finder.set_center_point(point_a, point_b)
radial_mass_finder.generate_masses()
radial_mass_finder.load_detail_area()

mass_a1 = radial_mass_finder.masses[0].geom
outputs = radial_mass_finder.finalize(mass_index, radius)

# save
mass_name = "mass{}".format(mass_index)
center_radius = str(radius)
x = str(math.floor(point_b[0]))
y = str(math.floor(point_b[1]))
total_counts = str(len(outputs))
point_index = str(point_index)
filename = mass_name + "_" + center_radius +"_"+point_index +"_"+ total_counts + "results"

data = MassResults(radius, point_b, mass_name, outputs)
print(data)
#with open('{}.pickle'.format(filename), 'wb') as f:
#    pickle.dump(data, f)
# ---------- end get_mass ----------
get_mass_2 = Script(site=S.site, mass_index=number_slider, point_a=python.point, point_b=pt_2, radius=python.radius, point_index=python.p_i)  # -> out, mass_a1, mass_a2, mass_a3, boundary; inputs mass_index: Int32
# ---------- get_mass_2: Python ----------
import sys
sys.path.append("C:\\Users\\User\\Documents\\computational_design\\narrative_architects")
from reload import reload_package
import funcs
reload_package(funcs)

from funcs import _utils
import Rhino.Geometry as geo

from funcs._mass_finder import *
from funcs.base import MassResults, MassResult
import math
import pickle

radial_mass_finder = RadialMassFinder(site)

radial_mass_finder.set_center_point(point_a, point_b)
radial_mass_finder.generate_masses()
#radial_mass_finder.load_detail_area()

mass_a1 = radial_mass_finder.masses[0].geom

#mass_a2 = radial_mass_finder.masses[1].geom
mass_a3 = radial_mass_finder.masses[2].geom
boundary = site.boundary
# ---------- end get_mass_2 ----------

python_2 = GhPythonScript()  # -> out, a; unedited script template

# ---- group: 수동으로 모듈 변경사항 업데이트. Module Watcher가 제대로 동작하지 않을때 체크하기 위함
module_reloader = GhPythonScript(run=Toggle(True))  # -> out; inputs run: Boolean
# ---------- module_reloader: Python ----------
import os
import importlib
import sys

import Rhino

if not Rhino.Runtime.HostUtils.RunningAsRhinoInside and run:
    PATH_CONNECTOR = '/' if os.name == 'posix' else '\\'

    APP_NAME = 'fx'
    ROOT_DIR = os.path.dirname(ghdoc.Path)
    print('ROOT', ROOT_DIR)

    APP_DIR = ROOT_DIR + PATH_CONNECTOR + APP_NAME

    def get_module_name(subdir, file_name):
        base_name = subdir.replace(ROOT_DIR + PATH_CONNECTOR, '').replace(PATH_CONNECTOR, '.')
        return base_name + '.' + file_name.replace('.py', '')
        
    to_delete = list()
    for module in sys.modules:
        if module.startswith(APP_NAME):
            to_delete.append(module)
    for module in to_delete:
        del sys.modules[module]
        
    for subdir, dirs, files in os.walk(APP_DIR):
        for f in files:
            if not f.endswith('.py') or f == '__init__.py':
                continue
            module_name = get_module_name(subdir, f)
            print(module_name)
            # 중복 리로드 막기
            if module_name in sys.modules:
                continue
            reload(importlib.import_module(module_name))
# ---------- end module_reloader ----------

# ---- group: output
pt_3 = Point(S.points)
crv_7 = Curve(get_mass_2.mass_a1)

# ----
panel_2 = Panel("""close_street
close_park
on_slope
on_forest_entrance""")
crv_8 = Curve()
crv_9 = Curve()
crv_10 = Curve()
python_3 = GhPythonScript(y=Slider(0, range=0..10))  # -> out, areas, geoms, centers, check_geom; inputs res: list, y: Int32
# ---------- python_3: Python ----------
from fx.utils import *

print(len(res))
print(res)
area_groups = res[y].area_groups

new_area_groups = []
seed_area_groups = [area_group for area_group in area_groups if area_group.is_area_set]

for area_group in seed_area_groups:
    expanded_area_group = area_group.horizontal_expand()
    
    new_area_groups.append(expanded_area_group)

geoms = ([area_group.geom for area_group in new_area_groups])


centers = [utils.get_center(geom) for geom in geoms]
areas = []

for area_group in new_area_groups:
    area_string = ""
    print(area_group.is_area_set)
    for k,v in area_group.area_data:
        area_string += str(k) + "_" + str(v) + "_"
    areas.append(area_string)
# ---------- end python_3 ----------
python_4 = GhPythonScript()  # -> out, areas, geoms, centers, check_geom; inputs res: list, y: Int32
# ---------- python_4: Python ----------
from fx.utils import *

print(len(res))
area_groups = res[y]

new_area_groups = []
seed_area_groups = [area_group for area_group in area_groups if area_group.is_area_set]

for area_group in seed_area_groups:
    expanded_area_group = area_group.horizontal_expand()
    
    new_area_groups.append(expanded_area_group)

geoms = ([area_group.geom for area_group in new_area_groups])


centers = [utils.get_center(geom) for geom in geoms]
areas = []

for area_group in new_area_groups:
    area_string = ""
    print(area_group.is_area_set)
    for k,v in area_group.area_data:
        area_string += str(k) + "_" + str(v) + "_"
    areas.append(area_string)
# ---------- end python_4 ----------
python_5 = GhPythonScript()  # -> out, a; inputs points: list of Point3d
# ---------- python_5: Python ----------
import Rhino.Geometry as geo
res = [] 
radius = radius/4
for point in points:
    point1= geo.Point3d(point[0]-radius,point[1]-radius,0)
    point2= geo.Point3d(point[0]+radius,point[1]-radius,0)
    point3= geo.Point3d(point[0]+radius,point[1]+radius,0)
    point4= geo.Point3d(point[0]-radius,point[1]+radius,0)
        
    res.append(geo.Polyline([point1, point2, point3, point4,point1]))
    geo.Polyline()
a = res
# ---------- end python_5 ----------
crv_11 = Curve(python_4.check_geom)
panel_3 = Panel(python_4.out)
panel_4 = Panel(python_3.areas)
panel_5 = Panel(python_3.out)
boundary = BoundarySurfaces(Edges=python_5.a)
item = ListItem(List=python_4.geoms, Index=Slider(1, range=0..10), Wrap=True)
crv_12 = Curve(python_4.geoms)
material = CreateMaterial(Diffuse=RGB(255, 105, 180), Specular=RGB(255, 255, 255), Emission=RGB(0, 0, 0), Transparency=0, Shine=0)
tag = TextTag(Location=python_4.centers, Text=python_4.areas)
boundary_2 = BoundarySurfaces(Edges=crv_12)
preview = CustomPreview(Geometry=boundary, Material=material)
