# Grasshopper definition RoomViewer.gh (Grasshopper 1.0.7)

collect = GhPythonScript()  # -> out, output_groups
# ---------- collect: Python ----------
import pickle
import os
print(os.getcwd())
folder1 = "second_res_m0"
folder2 = "second_res_m1"
file_name_list_m1 = []
file_name_list_m2 = []
os.chdir(folder1)
print(os.getcwd())
for file_name in os.listdir("./"):
    file_name_list_m1.append(file_name)
os.chdir("../")
os.chdir(folder2)
for file_name in os.listdir("./"):
    file_name_list_m2.append(file_name)
os.chdir("../")

outputs = []
success_point_index = [] 
success_file_by_point_index = {}
for file_name in file_name_list_m1:
    point_index = int(file_name.split("_")[2])
    result_count = int(file_name.split("_")[3].replace("results.pickle", ""))
    if result_count != 0 :
        print(point_index)
        success_file_by_point_index[point_index] = [file_name]

for file_name in file_name_list_m2:
    point_index = int(file_name.split("_")[2])
    result_count = int(file_name.split("_")[3].replace("results.pickle", ""))
    if point_index in success_file_by_point_index:
        success_file_by_point_index[point_index].append(file_name)


res_dict = {}
for k,v in success_file_by_point_index.items():
    if any([("mass1" in file_name) for file_name in v]):
        res_dict[k] = v
    else:
        pass
        
output_groups = []
for k,v in res_dict.items():
    output = {1:[], 2:[]} 
    for file_name in v:
        if "mass0" in file_name:
            path = os.path.join(folder1, file_name)
            with open(path, 'rb') as f:
                data = pickle.load(f)
                output[1].extend(data.outputs)
        else:
            path = os.path.join(folder2, file_name)
            with open(path, 'rb') as f:
                data = pickle.load(f)
                output[2].extend(data.outputs)
    output_groups.append(output)

output_groups
# ---------- end collect ----------
crv = Curve(<curve referenced from the Rhino model>)

# ---- group: 모듈 변경시 자동 업데이트
module_watcher = GhPythonScript(clear_cache=Button())  # -> out; inputs clear_cache: Boolean
# ---------- module_watcher: Python ----------
import os
import System
import clr
clr.AddReference('System.Core')
from System import Action, Func
import scriptcontext as sc
import time
import importlib
import sys

import Rhino
import scriptcontext as sc
from Grasshopper.Kernel import GH_FileWatcher
from Grasshopper.Kernel import GH_FileWatcherEvents


APP_NAME = 'fx'
ROOT_DIR = os.path.dirname(ghdoc.Path)
PATH_CONNECTOR = '/' if os.name == 'posix' else '\\'
APP_DIR = ROOT_DIR + PATH_CONNECTOR + APP_NAME

print('ROOT', ROOT_DIR)

def get_module_name(subdir, file_name):
    base_name = subdir.replace(ROOT_DIR + PATH_CONNECTOR, '').replace(PATH_CONNECTOR, '.')
    return base_name + '.' + file_name.replace('.py', '')

def reload_all():
    # import sys for windows
    import sys
    
    to_delete = list()
    for module in sys.modules:
        if module.startswith(APP_NAME):
            to_delete.append(module)
    for module in to_delete:
        del sys.modules[module]
        
    for subdir, dirs, files in os.walk(APP_DIR):
        for f in files:
            if not f.endswith('.py') or f == '__init__.py':
                continue
            module_name = get_module_name(subdir, f)
            print(module_name)
            # 중복 리로드 막기
            if module_name in sys.modules:
                continue
            try:
                reload(importlib.import_module(module_name))
            except:
                pass


def callback_func(sender, filename, change):
    reload_all()


def create_python_watcher(dir_name):
    print('create_python_watcher', dir_name)
    return GH_FileWatcher.CreateDirectoryWatcher.Overloads[System.String, System.String, GH_FileWatcherEvents, GH_FileWatcher.FileChanged](
        dir_name, '*.py', GH_FileWatcherEvents.All, callback_func)

class ModuleWatcher:

    def __init__(self):
        self.watcher_list = []
        self.collect_watcher_list()

    def collect_watcher_list(self):
        self.watcher_list.append(create_python_watcher(APP_DIR))
        for subdir, dirs, files in os.walk(APP_DIR):
            for d in dirs:
                dir_name = subdir + PATH_CONNECTOR + d
                self.watcher_list.append(create_python_watcher(dir_name))

    def dispose(self):
        for w in self.watcher_list:
            w.Dispose()

if clear_cache and 'module_watcher' in sc.sticky:
    print('dispose watcher')
    sc.sticky['module_watcher'].dispose()
    del sc.sticky['module_watcher']

if 'module_watcher' not in sc.sticky:
    sc.sticky['module_watcher'] = ModuleWatcher()
    print('module watcher is enabled')
# ---------- end module_watcher ----------
panel = Panel(module_watcher)

# ----
collect_2 = GhPythonScript()  # -> out, outputs
# ---------- collect_2: Python ----------
import pickle
import os
print(os.getcwd())
folder1 = "second_res_m0"
folder2 = "second_res_m1"
folder3 = "res_m2"
file_name_list_m3 = []
os.chdir(folder3)
print(os.getcwd())
for file_name in os.listdir("./"):
    file_name_list_m3.append(file_name)
os.chdir("../")

outputs = []
success_point_index = [] 
success_file_by_point_index = {}
outputs = []
for file_name in file_name_list_m3:
    path = os.path.join(folder3, file_name)
    print(path)
    with open(path, 'rb') as f:
        data = pickle.load(f)
        outputs.extend(data.outputs)
# ---------- end collect_2 ----------
filter = GhPythonScript(output_groups=collect.output_groups, sea=crv)  # -> out, new_output_groups, check_lines, check_area_group_geoms; inputs output_groups: list, sea: Curve
# ---------- filter: Python ----------
import Rhino.Geometry as geo
import math
from fx.utils import *

def find_area_group_by_program(program, area_groups):
    for area_group in area_groups:
        for area, name in area_group.area_data:
            print(name)
            if program == name:
                return area_group
    raise Exception("no such program : {}".format(program))
    
def area_group_view(area_group):
    radial_area = area_group.radial_area
    point = radial_area.c
    angle_mid = (radial_area.a2 + radial_area.a1) /2
    vec = geo.Vector3d(math.cos(angle_mid),math.sin(angle_mid),0)
    check_dist = 100
    return geo.LineCurve(geo.Line(point, vec*check_dist))
    

window_show_program = {1 : "community_corridor", 2: "exhibit_experience"}
new_output_groups = []
check_area_groups = []
for output_group in output_groups:
    new_output_group = {}
    if len(output_group[1])==0:
        continue
    print(output_group)
    for k,v in output_group.items():
        mass_no = k
        results =v 
        new_results = []
        for result in results:
            print(len(result.area_groups))
        for result in results:
            print(len(result.area_groups))
            check_program = window_show_program[mass_no]
            check_area_group = find_area_group_by_program(check_program, result.area_groups)
            check_area_groups.append(check_area_group)
            check_line = area_group_view(check_area_group)
            if utils.has_intersection(sea, check_line):
                new_results.append(result)
            else:
                continue
        new_output_group[mass_no] = new_results
    new_output_groups.append(new_output_group)
    
check_lines = []
check_area_group_geoms = []
for check_area_group in check_area_groups:
    check_lines.append(area_group_view(check_area_group))
    check_area_group_geoms.append(check_area_group.geom)
# ---------- end filter ----------
point_index = Slider(0, range=0..244)
필터_방_폭_m = Slider(1.5, range=0..10)
planmaker = GhPythonScript(outputs=collect_2.outputs, index=Slider(0, range=0..244), filter_width=Slider(1.5, range=0..10))  # -> out, mass_3_res, mass_3_res_uf; inputs outputs: list, index: Int32
# ---------- planmaker: Python ----------
import Rhino.Geometry as geo
from fx._plan_maker import PlanMaker
from copy import deepcopy


def get_center(region):
    # type: (geo.Curve) -> geo.Point3d
    """region의 중심점 찾기

    Args:
        region : 중심점을 찾을 영역

    Returns:
        중심점
    """

    return geo.AreaMassProperties.Compute(region).Centroid

# 첫번째는 point, 두번째는 1인지 ,2인지 3번은 결과물 인덱스
mass_3_res_uf = [] 
mass_3_res = []
for result in outputs:
    result = deepcopy(result)
    plan_maker = PlanMaker(result)
    plan_maker.process()
    
    mass_3_res_uf.append(plan_maker)

    if plan_maker.filter(filter_width):
        mass_3_res.append(plan_maker)
print("**************************************")
print("Room 생성 후 결과물 수 입니다.")
print("B 매스 필터 전 {}".format(len(mass_3_res_uf)))
print("B 매스 필터 후 {}".format(len(mass_3_res)))
print("필터는 방 폭을 확보했는지로 걸러냅니다. 필터전 결과물도 보고 싶다면 uf 노드를 연결하세요")
# ---------- end planmaker ----------
panel_2 = Panel(planmaker.out)
planmaker_2 = GhPythonScript(output_groups=filter.new_output_groups, index=point_index, filter_width=필터_방_폭_m)  # -> out, mass_1_res, mass_2_res, mass_1_res_uf, mass_2_res_uf; inputs output_groups: list, index: Int32
# ---------- planmaker_2: Python ----------
import Rhino.Geometry as geo
from fx._plan_maker import PlanMaker
from copy import deepcopy


def get_center(region):
    # type: (geo.Curve) -> geo.Point3d
    """region의 중심점 찾기

    Args:
        region : 중심점을 찾을 영역

    Returns:
        중심점
    """

    return geo.AreaMassProperties.Compute(region).Centroid

new_groups = []
for output_group in output_groups:
    is_vacant= False
    for k,v in output_group.items():
        if len(v) == 0 :
            is_vacant = True
    if is_vacant:
        pass
    else:
        new_groups.append(output_group)
print("*************************************")
print("포인트 인덱스를 조정해서 다른 결과물을 탐색해보세요")
print("*************************************")
for i, group in enumerate(new_groups):
    print("{}번째 포인트 인덱스 결과물은 다음과 같습니다.".format(i))
    print("A1(2층)결과물 {}".format(len(group[1])))
    print("A2(1층)결과물 {}".format(len(group[2])))
    
success_group = new_groups[index]

# 첫번째는 point, 두번째는 1인지 ,2인지 3번은 결과물 인덱스
mass_1_res_uf = [] 
mass_2_res_uf = []
mass_1_res = []
mass_2_res = []
for mass_no, results in success_group.items():
    for result in results:
        result = deepcopy(result)
        plan_maker = PlanMaker(result)
        plan_maker.process()
        if mass_no == 1:
            mass_1_res_uf.append(plan_maker)
        else:
            mass_2_res_uf.append(plan_maker)

        if plan_maker.filter(filter_width):
            if mass_no == 1:
                mass_1_res.append(plan_maker)
            else:
                mass_2_res.append(plan_maker)

print("**************************************")
print("Room 생성 후 결과물 수 입니다.")
print("A1 매스(2층) 필터 전 {}".format(len(mass_1_res_uf)))
print("A2 매스(1층) 필터 전 {}".format(len(mass_2_res_uf)))
print("A1 매스(2층) 필터 후 {}".format(len(mass_1_res)))
print("A2 매스(1층) 필터 후 {}".format(len(mass_2_res)))
print("필터는 방 폭을 확보했는지로 걸러냅니다. 필터전 결과물도 보고 싶다면 uf 노드를 연결하세요")
# ---------- end planmaker_2 ----------
a1_a2전환 = BooleanToggle(False)
panel_3 = Panel(planmaker_2.out)

# ---- group: 수동으로 모듈 변경사항 업데이트. Module Watcher가 제대로 동작하지 않을때 체크하기 위함
module_reloader = GhPythonScript(run=Toggle(True))  # -> out; inputs run: Boolean
# ---------- module_reloader: Python ----------
import os
import importlib
import sys

import Rhino

if not Rhino.Runtime.HostUtils.RunningAsRhinoInside and run:
    PATH_CONNECTOR = '/' if os.name == 'posix' else '\\'

    APP_NAME = 'fx'
    ROOT_DIR = os.path.dirname(ghdoc.Path)
    print('ROOT', ROOT_DIR)

    APP_DIR = ROOT_DIR + PATH_CONNECTOR + APP_NAME

    def get_module_name(subdir, file_name):
        base_name = subdir.replace(ROOT_DIR + PATH_CONNECTOR, '').replace(PATH_CONNECTOR, '.')
        return base_name + '.' + file_name.replace('.py', '')
        
    to_delete = list()
    for module in sys.modules:
        if module.startswith(APP_NAME):
            to_delete.append(module)
    for module in to_delete:
        del sys.modules[module]
        
    for subdir, dirs, files in os.walk(APP_DIR):
        for f in files:
            if not f.endswith('.py') or f == '__init__.py':
                continue
            module_name = get_module_name(subdir, f)
            print(module_name)
            # 중복 리로드 막기
            if module_name in sys.modules:
                continue
            reload(importlib.import_module(module_name))
# ---------- end module_reloader ----------

# ----
visualize2d = GhPythonScript(res_3=planmaker.mass_3_res_uf, index=Slider(108, range=0..420))  # -> out, geoms, centers, texts; inputs res_3: list, index: Int32
# ---------- visualize2d: Python ----------
name_dict = {
'사무실' :'office',
'회의실' :'meeting_room',
'장비실' :'tool_room',
'창고(수장)' :'storage',
'커뮤니티홀, 복도' :'community_corridor',
'화장실' :'toilet',
'계단실' :'stair',
'기계전기실' :'mech_room',
'전시/체험실' : 'exhibit_experience',
'체험실2' : 'experience2',
'토론방' : 'discuss_room',
'프로그램실1' : 'program1',
'프로그램실2'  : 'program2',
'전시준비실'  : 'exhibit_planning_room',
'무인카페' : 'unman_cafe',
'주방' : 'kitchen',
'주방창고' : 'kitchen_storage',
'안내휴게실' : 'reception',
'숙사1' : 'dorm1',
'숙사2' : 'dorm2',
'당직실' : 'night_work_room',
'탈의실/샤워실' : 'shower and change',
}


print(len(res_3))
plan_maker = res_3[index]
geom_group, texts_en, centers = plan_maker.get_2d()
geoms = []

for g in geom_group:
    geoms.extend(g)
    

texts = []
for text in texts_en:
    is_founded = False
    for k,v in name_dict.items():
        if v == text:
            texts.append(k)
            is_founded = True
            break
    if not is_founded:
        print("******************")
        print(text)
        texts.append("이름 확인필요")
# ---------- end visualize2d ----------

visualize3d = GhPythonScript(res_1=planmaker_2.mass_1_res_uf, res_2=planmaker_2.mass_2_res_uf, index=Slider(0, range=0..420))  # -> out, geoms, centers, texts, geom_3d_2, geom_3d_1; inputs res_1: list, res_2: list, index: Int32
# ---------- visualize3d: Python ----------
name_dict = {
'사무실' :'office',
'회의실' :'meeting_room',
'장비실' :'tool_room',
'창고(수장)' :'storage',
'커뮤니티홀, 복도' :'community_corridor',
'화장실' :'toilet',
'계단실' :'stair',
'기계전기실' :'mech_room',
'전시/체험실' : 'exhibit_experience',
'체험실2' : 'experience2',
'토론방' : 'discuss_room',
'프로그램실1' : 'program1',
'프로그램실2'  : 'program2',
'전시준비실'  : 'exhibit_planning_room',
'무인카페' : 'unman_cafe',
'주방' : 'kitchen',
'주방창고' : 'kitchen_storage',
'안내휴게실' : 'reception',
'숙사1' : 'dorm1',
'숙사2' : 'dorm2',
'당직실' : 'night_work_room',
'탈의실/샤워실' : 'shower and change',
}

res_list = []
for pm1 in res_1:
    for pm2 in res_2:
        res_list.append((pm1, pm2))
print(len(res_list))
from random import shuffle
shuffle(res_list)
plan_maker1, plan_maker2 = res_list[index]

geom_group, texts_en, centers = plan_maker1.get_2d()
geom_3d_2 = plan_maker2.get_3d(0,3)
geom_3d_1 = plan_maker1.get_3d(3,3)
geoms = []

for g in geom_group:
    geoms.extend(g)
    

texts = []
for text in texts_en:
    is_founded = False
    for k,v in name_dict.items():
        if v == text:
            texts.append(k)
            is_founded = True
            break
    if not is_founded:
        print("******************")
        print(text)
        texts.append("이름 확인필요")
# ---------- end visualize3d ----------
brep = Brep(visualize3d.geom_3d_1)
brep_2 = Brep(visualize3d.geom_3d_2)

visualize2d_2 = GhPythonScript(res_1=planmaker_2.mass_1_res_uf, res_2=planmaker_2.mass_2_res_uf, index=Slider(0, range=0..420), toggle_view=a1_a2전환)  # -> out, geoms, centers, texts; inputs res_1: list, res_2: list, index: Int32, toggle_view: Boolean
# ---------- visualize2d_2: Python ----------
name_dict = {
'사무실' :'office',
'회의실' :'meeting_room',
'장비실' :'tool_room',
'창고(수장)' :'storage',
'커뮤니티홀, 복도' :'community_corridor',
'화장실' :'toilet',
'계단실' :'stair',
'기계전기실' :'mech_room',
'전시/체험실' : 'exhibit_experience',
'체험실2' : 'experience2',
'토론방' : 'discuss_room',
'프로그램실1' : 'program1',
'프로그램실2'  : 'program2',
'전시준비실'  : 'exhibit_planning_room',
'무인카페' : 'unman_cafe',
'주방' : 'kitchen',
'주방창고' : 'kitchen_storage',
'안내휴게실' : 'reception',
'숙사1' : 'dorm1',
'숙사2' : 'dorm2',
'당직실' : 'night_work_room',
'탈의실/샤워실' : 'shower and change',
}
print("index조정할 수 있는 최대치")
if toggle_view:
    print(len(res_1))
    plan_maker = res_1[index]
    geom_group, texts_en, centers = plan_maker.get_2d()
else:
    print(len(res_2))
    plan_maker = res_2[index]
    geom_group, texts_en, centers = plan_maker.get_2d()
geoms = []

for g in geom_group:
    geoms.extend(g)
    

texts = []
for text in texts_en:
    is_founded = False
    for k,v in name_dict.items():
        if v == text:
            texts.append(k)
            is_founded = True
            break
    if not is_founded:
        print("******************")
        print(text)
        texts.append("이름 확인필요")
# ---------- end visualize2d_2 ----------
crv_2 = Curve(visualize2d.geoms)
tag = TextTag(Location=visualize2d.centers, Text=visualize2d.texts)
panel_4 = Panel(visualize2d_2.out)
panel_5 = Panel(visualize2d.out)
tag_2 = TextTag(Location=visualize2d_2.centers, Text=visualize2d_2.texts)
crv_3 = Curve(visualize2d_2.geoms)
